% Simulink data dictionary app.sldd

byte0 = Simulink.Signal(StorageClass="ExportedGlobal", DataType="uint8")
byte1 = Simulink.Signal(StorageClass="ExportedGlobal", DataType="uint8")
bLedState = Simulink.Parameter(1, StorageClass="ExportedGlobal", DataType="uint8")
sine = Simulink.Signal(StorageClass="ExportedGlobal", DataType="uint32")
V_AIN0_mV = Simulink.Signal(StorageClass="ExportedGlobal", DataType="uint16")
V_AIN1_mV = Simulink.Signal(StorageClass="ExportedGlobal", DataType="uint16")
V_AIN2_mV = Simulink.Signal(StorageClass="ExportedGlobal", DataType="uint16")
V_AIN3_mV = Simulink.Signal(StorageClass="ExportedGlobal", DataType="uint16")